# Grasshopper definition circles GCODE OK.gh (Grasshopper 1.0.7)

# ---- group: workinng area
number_slider = Slider(2, range=0..2)
division = Division(A=Slider(250, range=0..1000), B=number_slider)
division_2 = Division(A=Slider(280, range=0..1000), B=number_slider)
construct_domain = ConstructDomain(DomainStart=expr("-x", division), DomainEnd=division)
construct_domain_2 = ConstructDomain(DomainStart=expr("-x", division_2), DomainEnd=division_2)
xy_plane = XYPlane(Origin=Point(0, 0, 0))
rectangle = Rectangle(Plane=xy_plane, XSize=construct_domain_2, YSize=construct_domain, Radius=0)  # -> Rectangle, Length

# ---- group: curvas
curve_exterior = Curve(<curve referenced from the Rhino model>)
curve_interior = Curve(<curve referenced from the Rhino model>)
curve_trace = Curve(<curve referenced from the Rhino model>)

# ----
number_slider_2 = Slider(4, range=0..10)
number_slider_3 = Slider(0.304, range=0..1)
curve_to_polyline = CurveToPolyline(Curve=curve_interior, ToleranceDistance=number_slider_3, ToleranceAngle=0)  # -> Polyline, Segments
curve_to_polyline_2 = CurveToPolyline(Curve=curve_trace, ToleranceDistance=number_slider_3, ToleranceAngle=0)  # -> Polyline, Segments
curve_to_polyline_3 = CurveToPolyline(Curve=curve_exterior, ToleranceDistance=number_slider_3, ToleranceAngle=0)  # -> Polyline, Segments

discontinuity = Discontinuity(Curve=curve_to_polyline.Polyline, Level=1)  # -> flatten(Points), Parameters
discontinuity_2 = Discontinuity(Curve=curve_to_polyline_2.Polyline, Level=1)  # -> flatten(Points), Parameters
discontinuity_3 = Discontinuity(Curve=curve_to_polyline_3.Polyline, Level=1)  # -> flatten(Points), Parameters
list_item = ListItem(List=discontinuity.Points, Index=Slider(0, range=0..100), Wrap=True)
list_length = ListLength(List=discontinuity.Points)
list_item_2 = ListItem(List=discontinuity_2.Points, Index=Slider(0, range=0..100), Wrap=True)
list_length_2 = ListLength(List=discontinuity_2.Points)
list_item_3 = ListItem(List=discontinuity_3.Points, Index=Slider(0, range=0..100), Wrap=True)
insert_items = InsertItems(List=discontinuity.Points, Item=list_item, Indices=list_length, Wrap=True)  # -> flatten(List)
closedcurve = BooleanToggle(False)
insert_items_2 = InsertItems(List=discontinuity_2.Points, Item=list_item_2, Indices=list_length_2, Wrap=True)  # -> flatten(List)
closedcurve_2 = BooleanToggle(False)
cls = Closed(Curve=curve_to_polyline.Polyline)  # -> Closed, Periodic
list_length_3 = ListLength(List=discontinuity_3.Points)
cls_2 = Closed(Curve=curve_to_polyline_2.Polyline)  # -> Closed, Periodic
insert_items_3 = InsertItems(List=discontinuity_3.Points, Item=list_item_3, Indices=list_length_3, Wrap=True)  # -> flatten(List)
closedcurve_3 = BooleanToggle(False)
cls_3 = Closed(Curve=curve_to_polyline_3.Polyline)  # -> Closed, Periodic
filter = StreamFilter(Gate=cls.Closed, Stream0=discontinuity.Points, Stream1=insert_items)
filter_2 = StreamFilter(Gate=cls_2.Closed, Stream0=discontinuity_2.Points, Stream1=insert_items_2)
filter_3 = StreamFilter(Gate=cls_3.Closed, Stream0=discontinuity_3.Points, Stream1=insert_items_3)

list_item_4 = ListItem(List=flatten(filter_3), Index=Slider(0, range=0..100), Wrap=True)
deconstruct = Deconstruct(Point=flatten(list_item_4))  # -> XComponent, YComponent, ZComponent
concatenate = Concatenate(G=" G1", X="X", X_value=deconstruct.XComponent, Y=" Y", Y_value=deconstruct.YComponent, F=" F", F_value=" 4800")
panel = Panel(concatenate)

list_item_5 = ListItem(List=flatten(filter), Index=Slider(0, range=0..100), Wrap=True)
deconstruct_2 = Deconstruct(Point=filter)  # -> XComponent, YComponent, ZComponent
deconstruct_3 = Deconstruct(Point=filter_2)  # -> XComponent, YComponent, ZComponent
deconstruct_4 = Deconstruct(Point=flatten(list_item_5))  # -> XComponent, YComponent, ZComponent

# ---- group: vitesse print
panel_2 = Panel(" 1800")

# ----
deconstruct_5 = Deconstruct(Point=flatten(filter_3))  # -> XComponent, YComponent, ZComponent
concatenate_2 = Concatenate(
    G="G1",
    X=" X",
    X_value=deconstruct_5.XComponent,
    Y=" Y",
    Y_value=deconstruct_5.YComponent,
    Z=" Z",
    Z_value=deconstruct_5.ZComponent,
    F=" F",
    F_value=panel_2)
panel_3 = Panel(concatenate_2)

list_item_6 = ListItem(List=flatten(filter_2), Index=Slider(0, range=0..100), Wrap=True)
deconstruct_6 = Deconstruct(Point=flatten(list_item_6))  # -> XComponent, YComponent, ZComponent
list_item_7 = ListItem(List=reverse(deconstruct_2.ZComponent), Index=0, Wrap=True)
number_slider_4 = Slider(100, range=0..100)
addition = Addition(A=list_item_7, B=Slider(1, range=0..1))
concatenate_3 = Concatenate(G=" G1", X="X", X_value=deconstruct_6.XComponent, Y=" Y", Y_value=deconstruct_6.YComponent, F=" F", F_value=" 600")
concatenate_4 = Concatenate(G=" G1", Z=" Z", Z_value=addition, F=" F", F_value=" 420")
panel_4 = Panel(concatenate_3)
panel_5 = Panel(concatenate_4)

concatenate_5 = Concatenate(
    G="G1",
    X="X",
    X_value=deconstruct_2.XComponent,
    Y=" Y",
    Y_value=deconstruct_2.YComponent,
    Z=" Z",
    Z_value=deconstruct_2.ZComponent,
    F=" F",
    F_value=" 1800")

# ---- group: out speed
panel_6 = Panel(" 600")

# ----
concatenate_6 = Concatenate(
    G="G1",
    X="X",
    X_value=deconstruct_3.XComponent,
    Y=" Y",
    Y_value=deconstruct_3.YComponent,
    Z=" Z",
    Z_value=deconstruct_3.ZComponent,
    F=" F",
    F_value=" 1800")

# ---- group: end speed
panel_7 = Panel(" 420")

# ----
list_item_8 = ListItem(List=reverse(deconstruct_5.ZComponent), Index=0, Wrap=True)
number_slider_5 = Slider(100, range=0..100)
addition_2 = Addition(A=list_item_8, B=Slider(1, range=0..1))
concatenate_7 = Concatenate(G=" G1", X="X", X_value=deconstruct_4.XComponent, Y=" Y", Y_value=deconstruct_4.YComponent, F=" F", F_value=panel_6)
concatenate_8 = Concatenate(G=" G1", Z=" Z", Z_value=addition_2, F=" F", F_value=panel_7)
panel_8 = Panel(concatenate_7)
panel_9 = Panel(concatenate_8)

panel_10 = Panel(concatenate_5)
panel_11 = Panel(concatenate_6)
merge = Merge(
    Data1=flatten(panel),
    Data2=flatten(panel_3),
    Data3=flatten(panel_9),
    Data4=flatten(panel_8),
    Data5=flatten(panel_10),
    Data7=flatten(panel_5),
    Data8=flatten(panel_4),
    Data9=flatten("G4 S3"),
    Data10=flatten(panel_11))
# ;machine_type: Guider II S Series
# ;right_extruder_material: PLA
# ;right_extruder_material_density: 1.24
# ;filament_diameter0: 1.75
# ;right_extruder_temperature: 220
# ;layer_height: 0.18
# ;perimeter_shells: 1
# ;top_solid_layers: 0
# ;bottom_solid_layers: 3
# ;fill_density: 0%
# ;fill_pattern: line
# ;base_print_speed: 60
# ;travel_speed: 80
# ;platform_temperature: 60
# ;right_extruder_temperature_raft0: 0
# ;right_extruder_temperature_reset:
# ;left_extruder_temperature_reset:
# ;start gcode
#  M118 X23.50 Y23.50 Z45.60 T0
#  M140 S60 T0
#  M104 S220 T0
#  M104 S0 T1
#  M107
#  G90
#  G28
#  M132 X Y Z A B
#  G1 Z50.000 F420
#  G161 X Y F3300
#  M7 T0
#  M6 T0
#  M651 S255
# N14 M108 T0
panel_12 = Panel("""M104 S0 T0
M140 S0 T0
G162 Z F1800
G28 X Y
M132 X Y A B 
M652
G91
M18""")
panel_13 = Panel(merge)
