# Grasshopper definition circles.gh (Grasshopper 1.0.7)

# ---- group: workinng area
number_slider = Slider(250, range=0..1000)
number_slider_2 = Slider(2, range=0..2)
division = Division(A=number_slider, B=number_slider_2)
division_2 = Division(A=Slider(280, range=0..1000), B=number_slider_2)
construct_domain = ConstructDomain(DomainStart=expr("-x", division), DomainEnd=division)
construct_domain_2 = ConstructDomain(DomainStart=expr("-x", division_2), DomainEnd=division_2)
xy_plane = XYPlane(Origin=Point(0, 0, 0))
rectangle = Rectangle(Plane=xy_plane, XSize=construct_domain_2, YSize=construct_domain, Radius=0)  # -> Rectangle, Length

# ---- group: curvas
curve_exterior = Curve(<curve referenced from the Rhino model>)
curve_interior = Curve(<curve referenced from the Rhino model>)
curve_plie = Curve(<curve referenced from the Rhino model>)

# ----
number_slider_3 = Slider(4, range=0..10)
number_slider_4 = Slider(0.304, range=0..1)
curve_to_polyline = CurveToPolyline(Curve=curve_interior, ToleranceDistance=number_slider_4, ToleranceAngle=0)  # -> Polyline, Segments
divide_length = DivideLength(Curve=curve_interior, Length=number_slider_3)  # -> Points, Tangents, Parameters
curve_to_polyline_2 = CurveToPolyline(Curve=curve_exterior, ToleranceDistance=number_slider_4, ToleranceAngle=0)  # -> Polyline, Segments
divide_length_2 = DivideLength(Curve=curve_plie, Length=number_slider_3)  # -> Points, Tangents, Parameters
divide_length_3 = DivideLength(Curve=curve_exterior, Length=number_slider_3)  # -> Points, Tangents, Parameters
curve_to_polyline_3 = CurveToPolyline(Curve=curve_plie, ToleranceDistance=number_slider_4, ToleranceAngle=0)  # -> Polyline, Segments

polyline = PolyLine(Vertices=divide_length.Points, Closed=False)
discontinuity = Discontinuity(Curve=polyline, Level=1)  # -> flatten(Points), Parameters
closed = Closed(Curve=polyline)  # -> Closed, Periodic
list_item = ListItem(List=discontinuity.Points, Index=Slider(0, range=0..100), Wrap=True)
list_length = ListLength(List=polyline)
insert_items = InsertItems(List=polyline, Item=list_item, Indices=list_length, Wrap=True)  # -> flatten(List)

polyline_2 = PolyLine(Vertices=divide_length_3.Points, Closed=False)
discontinuity_2 = Discontinuity(Curve=polyline_2, Level=1)  # -> flatten(Points), Parameters
closed_2 = Closed(Curve=polyline_2)  # -> Closed, Periodic
list_length_2 = ListLength(List=polyline_2)
list_item_2 = ListItem(List=discontinuity_2.Points, Index=Slider(0, range=0..100), Wrap=True)
insert_items_2 = InsertItems(List=polyline_2, Item=list_item_2, Indices=list_length_2, Wrap=True)  # -> flatten(List)

polyline_3 = PolyLine(Vertices=divide_length_2.Points, Closed=False)
discontinuity_3 = Discontinuity(Curve=polyline_3, Level=1)  # -> flatten(Points), Parameters
closed_3 = Closed(Curve=polyline_3)  # -> Closed, Periodic
list_item_3 = ListItem(List=discontinuity_3.Points, Index=Slider(0, range=0..100), Wrap=True)
list_length_3 = ListLength(List=polyline_3)
insert_items_3 = InsertItems(List=polyline_3, Item=list_item_3, Indices=list_length_3, Wrap=True)  # -> flatten(List)

stream_filter = StreamFilter(Gate=closed_3.Closed, Stream0=discontinuity_3.Points, Stream1=insert_items_3)
stream_filter_2 = StreamFilter(Gate=closed.Closed, Stream0=discontinuity.Points, Stream1=insert_items)
stream_filter_3 = StreamFilter(Gate=closed_2.Closed, Stream0=discontinuity_2.Points, Stream1=insert_items_2)
panel = Panel(stream_filter_3)
list_length_4 = ListLength(List=[stream_filter_3, stream_filter, stream_filter_2])

series = Series(Start=0, Step=1, Count=list_length_4)
addition = Addition(A=series, B=Slider(1, range=0..1))
list_item_4 = ListItem(List=[stream_filter, stream_filter_3, stream_filter_2], Index=series, Wrap=True)
list_item_5 = ListItem(List=[stream_filter, stream_filter_3, stream_filter_2], Index=addition, Wrap=True)
distance = Distance(PointA=list_item_4, PointB=list_item_5)
shift_list = ShiftList(List=distance, Shift=1, Wrap=True)
mass_addition = MassAddition(Input=shift_list)  # -> Result, PartialResults

number_slider_5 = Slider(20, range=0..100)
subtraction = Subtraction(A=division, B=number_slider_5)
subtraction_2 = Subtraction(A=division_2, B=number_slider_5)
multiplication = Multiplication(A=number_slider_5, B=Slider(2, range=0..10))

list_item_6 = ListItem(List=flatten([stream_filter, stream_filter_3, stream_filter_2]), Index=Slider(0, range=0..100), Wrap=True)
deconstruct = Deconstruct(Point=flatten(list_item_6))  # -> XComponent, YComponent, ZComponent
concatenate = Concatenate(G=" G1", X="X", X_value=deconstruct.XComponent, Y=" Y", Y_value=deconstruct.YComponent, F=" F", F_value=" 4800")
panel_2 = Panel(concatenate)

negative = Negative(Value=subtraction_2)
negative_2 = Negative(Value=subtraction)
subtraction_3 = Subtraction(A=number_slider, B=multiplication)
multiplication_2 = Multiplication(A=subtraction_3, B=" 0.13")
subtraction_4 = Subtraction(A=multiplication_2, B=" 1")

# ---- group: vitesse print
panel_3 = Panel(" 1800")

# ----
deconstruct_2 = Deconstruct(Point=list_item_4)  # -> XComponent, YComponent, ZComponent
addition_2 = Addition(A=deconstruct_2.ZComponent, B=Slider(28, range=0..100))
concatenate_2 = Concatenate(
    G="G1",
    X="X",
    X_value=deconstruct_2.XComponent,
    Y="Y",
    Y_value=deconstruct_2.YComponent,
    Z="Z",
    extrude=" E",
    F=" F",
    F_value=panel_3)
panel_4 = Panel(concatenate_2)

# ---- group: moving speed
panel_5 = Panel(" 1200")

# ----
concatenate_3 = Concatenate(G=" G1", E=" E", E_value=subtraction_4, F=" F", F_value="499")
concatenate_4 = Concatenate(G=" G1", X="X", X_value=negative, Y=" Y", Y_value=negative_2, F=" F", F_value=" 4800")

# ---- group: moving speed
panel_6 = Panel("420")

# ----
concatenate_5 = Concatenate(G=" G1", Z=" Z", Z_value=Slider(0.2, range=0..1), F=" F", F_value=panel_6)
concatenate_6 = Concatenate(G=" G1", X=" X", X_value=negative, Y=" Y", E=" E", E_Value=multiplication_2, F=" F", F_value=panel_5)
panel_7 = Panel(" 0.13041")

# ---- group: retractation speed
panel_8 = Panel("499")

# ----
concatenate_7 = Concatenate(G=" G1", E=" E", F="F", F_value=panel_6)
panel_9 = Panel(concatenate_4)
panel_10 = Panel(concatenate_5)
concatenate_8 = Concatenate(G=" G1", E=" E", E_value=multiplication_2, F=" F", F_value=panel_8)
panel_11 = Panel(concatenate_3)
panel_12 = Panel(concatenate_6)

# ---- group: out speed
panel_13 = Panel(" 600")

# ----
panel_14 = Panel(concatenate_7)

# ---- group: end speed
panel_15 = Panel(" 420")

# ----
list_item_7 = ListItem(List=reverse(addition_2), Index=0, Wrap=True)
number_slider_6 = Slider(100, range=0..100)
addition_3 = Addition(A=list_item_7, B=Slider(0.25, range=0..1))
concatenate_9 = Concatenate(G=" G1", X="X", X_value=number_slider_6, Y=" Y", Y_value=number_slider_6, F=" F", F_value=panel_13)
concatenate_10 = Concatenate(G=" G1", Z="Z", Z_value=addition_3, F=" F", F_value=panel_15)
panel_16 = Panel(concatenate_10)
panel_17 = Panel(concatenate_9)

panel_18 = Panel(concatenate_8)
panel_19 = Panel(""" ;raft
;layer:0.28""")
subtraction_5 = Subtraction()
merge = Merge(
    Data1=concatenate_4,
    Data2=" ;preEctrude : 0.20",
    Data3=concatenate_5,
    Data4=" ;structure:pre-extrude",
    Data5=concatenate_4,
    Data6=concatenate_6,
    Data7=panel_19,
    Data8=concatenate_3,
    Data9=concatenate_7,
    Data10=concatenate,
    Data11=concatenate_8,
    Data12=" G92 E0")
panel_20 = Panel(merge)
panel_21 = Panel(""";machine_type: Guider II S Series
;right_extruder_material: PLA
;right_extruder_material_density: 1.24
;filament_diameter0: 1.75
;right_extruder_temperature: 220
;layer_height: 0.18
;perimeter_shells: 1
;top_solid_layers: 0
;bottom_solid_layers: 3
;fill_density: 0%
;fill_pattern: line
;base_print_speed: 60
;travel_speed: 80
;platform_temperature: 60
;right_extruder_temperature_raft0: 0
;right_extruder_temperature_reset: 
;left_extruder_temperature_reset: 
;start gcode
 M118 X23.50 Y23.50 Z45.60 T0
 M140 S60 T0
 M104 S220 T0
 M104 S0 T1
 M107
 G90
 G28
 M132 X Y Z A B
 G1 Z50.000 F420
 G161 X Y F3300
 M7 T0
 M6 T0
 M651 S255
N14 M108 T0""")
panel_22 = Panel("""M104 S0 T0
M140 S0 T0
G162 Z F1800
G28 X Y
M132 X Y A B 
M652
G91
M18""")
merge_2 = Merge(
    Data1=flatten(panel_21),
    Data2=flatten(merge),
    Data3=flatten(concatenate_2),
    Data4=flatten(concatenate_10),
    Data5=flatten(panel_17),
    Data6=flatten(panel_22))
panel_23 = Panel(merge_2)
